# Dynamo graph Column Rotation.dyn (Dynamo 0.9.1.4062)

select_model_elements = DSModelElementsSelection()  # 6 picked in the model
number_slider = DoubleSlider(90, range=0..360 step 30)
setRotation = FamilyInstance.SetRotation(familyInstance=select_model_elements, degree=number_slider)
