# Dynamo graph Multi-Level .dyn (Dynamo 0.9.1.4062)

select_model_element = DSModelElementSelection()  # 1 picked in the model
code_block = CodeBlock { 3000.000; }
number_slider = DoubleSlider(10, range=0..100 step 1)
sequence = Sequence(start=code_block, amount=number_slider, step=code_block, lacing=Longest)
byLevelAndOffset = Level.ByLevelAndOffset(select_model_element, sequence)
