# Dynamo graph Rename Sheet series.dyn (Dynamo 0.9.1.4062)

categories = Categories("Sheets")
all_elements_of_category = ElementsOfCategory(categories)
sheetNumber = Sheet.SheetNumber()
sortByFunction = SortByFunction(all_elements_of_category, sheetNumber)
code_block = CodeBlock { 12; 22; 1; }
slice = List.Slice(sortByFunction, code_block.out0, code_block.out1, code_block.out2)
code_block_2 = CodeBlock { "Sheet Number"; }
code_block_3 = CodeBlock { 15; 1; }
count = List.Count(slice)
add = code_block_3.out0 + count
range = Range(start=code_block_3.out0, end=add, step=code_block_3.out1, lacing=Longest)
string_from_object = FromObject(range)
code_block_4 = CodeBlock { 0; "A"; }
insert = String.Insert(str=string_from_object, index=code_block_4.out0, toInsert=code_block_4.out1)
setParameterByName = Element.SetParameterByName(element=slice, parameterName=code_block_2, value=insert)
