# Dynamo graph Windows Parameter.dyn (Dynamo 0.9.1.4062)

select_model_elements = DSModelElementsSelection()  # 495 picked in the model
string = StringInput("Head Height")
number_slider = DoubleSlider(2000, range=1800..2100 step 100)
setParameterByName = Element.SetParameterByName(element=select_model_elements, parameterName=string, value=number_slider)
